# Grasshopper definition algorithm.gh (Grasshopper 0.9.80)

x_y_thickness = Slider(2.612, range=2..3)
width = Slider(136, range=130..140)
z = Slider(6.111, range=3..7)
temple_height = Slider(4.523, range=0..10)
side_thickness = Slider(6.25, range=5.75..6.25)
bottom_temple = Slider(129.908, range=0..200)
top_temple = Slider(-4, range=-50..100)
bridge_thickness = Slider(4.5, range=4.5..5.5)
pd = Slider(66, range=65..70)
bridge_height = Slider(3.143, range=0..7)
bottom_bridge = Slider(73.217, range=0..100)
top_bridge = Slider(52, range=0..100)
slit_height = Slider(-2.6, range=-10..10)
lens = Geometry(<curve referenced from the Rhino model>)

# ---- group: inner frame
connect = ConnectCurves(Curves=lens, Continuity=2, Close=True, Bulge=1)
closed_lens = Geometry(connect)
area = Area(Geometry=closed_lens)  # -> Area, Centroid
centerpoint = Point(area.Centroid)
pdecon = Deconstruct(Point=centerpoint)  # -> XComponent, YComponent, ZComponent
number = Number(-1)
number_2 = Number(-1)
multiplication = Multiplication(A=pdecon.YComponent, B=number)
multiplication_2 = Multiplication(A=number_2, B=pdecon.XComponent)
X = UnitX(Factor=multiplication_2)
Y = UnitY(Factor=multiplication)
move = Move(Geometry=lens, Motion=X)  # -> Geometry, Transform
move_2 = Move(Geometry=move.Geometry, Motion=Y)  # -> Geometry, Transform
inner_lens = Geometry(move_2.Geometry)

# ---- group: center line
_0_0_0 = Point(Point(0, 0, 0))
Y_2 = UnitY(Factor=bridge_thickness)
move_3 = Move(Geometry=_0_0_0, Motion=Y_2)  # -> Geometry, Transform
bottom_center_bridge = Point(_0_0_0)
top_center_bridge = Point(move_3.Geometry)
Y_3 = UnitY(Factor=bridge_height)
move_4 = Move(Geometry=bottom_center_bridge, Motion=Y_3)  # -> Geometry, Transform
move_5 = Move(Geometry=top_center_bridge, Motion=Y_3)  # -> Geometry, Transform
ln = Line(StartPoint=move_4.Geometry, EndPoint=move_5.Geometry)
center_line = Geometry(ln)

# ---- group: side
division = Division(A=width, B=2)
Y_4 = UnitY(Factor=temple_height)
division_2 = Division(A=width, B=2)
_0 = Number(0)
_0_2 = Number(0)
_0_3 = Number(0)
pt = ConstructPoint(XCoordinate=division, YCoordinate=side_thickness, ZCoordinate=_0)
pt_2 = ConstructPoint(XCoordinate=division_2, YCoordinate=_0_2, ZCoordinate=_0_3)
move_6 = Move(Geometry=pt, Motion=Y_4)  # -> Geometry, Transform
move_7 = Move(Geometry=pt_2, Motion=Y_4)  # -> Geometry, Transform
top_right_point = Point(move_6.Geometry)
bottom_right_point = Point(move_7.Geometry)
ln_2 = Line(StartPoint=move_6.Geometry, EndPoint=move_7.Geometry)
side = Geometry(ln_2)

# ---- group: bridge slit
center_line_2 = Geometry(reverse(center_line))
end = EndPoints(Curve=center_line_2)  # -> Start, End
X_2 = UnitX(Factor=20)
move_8 = Move(Geometry=end.Start, Motion=X_2)  # -> Geometry, Transform
Y_5 = UnitY(Factor=-0.5)
move_9 = Move(Geometry=move_8.Geometry, Motion=Y_5)  # -> Geometry, Transform
rec_2pt = Rectangle2Pt(Plane=PlaneXY(0, 0, 0), PointA=move_9.Geometry, PointB=end.Start, Radius=0)  # -> Rectangle, Length
Y_6 = UnitY(Factor=slit_height)
move_10 = Move(Geometry=rec_2pt.Rectangle, Motion=Y_6)  # -> Geometry, Transform
bridge_slit = Surface(move_10.Geometry)

# ---- group: move PD
_2 = Number(2)
division_3 = Division(A=pd, B=_2)
X_3 = UnitX(Factor=division_3)
move_11 = Move(Geometry=inner_lens, Motion=X_3)  # -> Geometry, Transform

# ---- group: outer frame
offset = Offset(Curve=move_11.Geometry, Distance=x_y_thickness, Plane=PlaneXY(0, 0, 0), Corners=1)
outer_frame = Geometry(flatten(offset))

# ---- group: temple
side_2 = Geometry(side)
end_2 = EndPoints(Curve=side_2)  # -> Start, End
top_point = Point(end_2.Start)
bottom_point = Point(end_2.End)
X_4 = UnitX(Factor=-1)
move_12 = Move(Geometry=top_point, Motion=X_4)  # -> Geometry, Transform
X_5 = UnitX(Factor=-1)
move_13 = Move(Geometry=bottom_point, Motion=X_5)  # -> Geometry, Transform
eval = EvaluateCurve(Curve=outer_frame, Parameter=top_temple)  # -> Point, Tangent, Angle
addition = Addition(A=top_temple, B=1)
eval_2 = EvaluateCurve(Curve=outer_frame, Parameter=addition)  # -> Point, Tangent, Angle
eval_3 = EvaluateCurve(Curve=outer_frame, Parameter=bottom_temple)  # -> Point, Tangent, Angle
addition_2 = Addition(A=bottom_temple, B=1)
eval_4 = EvaluateCurve(Curve=outer_frame, Parameter=addition_2)  # -> Point, Tangent, Angle
intcrv = Interpolate(Vertices=[top_point, move_12.Geometry, eval.Point, eval_2.Point], Degree=3, Periodic=False, KnotStyle=1)  # -> Curve, Length, Domain
ln_3 = Line(StartPoint=eval_2.Point, EndPoint=eval_3.Point)
intcrv_2 = Interpolate(Vertices=[eval_3.Point, eval_4.Point, move_13.Geometry, bottom_point], Degree=3, Periodic=False, KnotStyle=1)  # -> Curve, Length, Domain
join = JoinCurves(Curves=[side_2, ln_3, intcrv.Curve, intcrv_2.Curve], Preserve=False)

# ---- group: hinge
side_temple = Geometry(side)
len = Length(Curve=side_temple)
multiplication_3 = Multiplication(A=len, B=-1)
X_6 = UnitX(Factor=multiplication_3)
move_14 = Move(Geometry=side_temple, Motion=X_6)  # -> Geometry, Transform
end_3 = EndPoints(Curve=move_14.Geometry)  # -> Start, End
end_4 = EndPoints(Curve=side_temple)  # -> Start, End
pt_3 = Point(end_3.Start)
pt_4 = Point(end_4.End)
box = Box2Pt(PointA=pt_3, PointB=pt_4, Plane=PlaneXY(0, 0, 0))
area_2 = Area(Geometry=box)  # -> Area, Centroid
circle = CircleCNR(Center=area_2.Centroid, Normal=Vector(0, 0, 1), Radius=Slider(2.5, range=0..10))
square = Geometry(box)
Z = UnitZ(Factor=1.5)
move_15 = Move(Geometry=circle, Motion=Z)  # -> Geometry, Transform
Z_2 = UnitZ(Factor=10)
extr = Extrude(Base=square, Direction=Z_2)
Z_3 = UnitZ(Factor=20)
extr_2 = Extrude(Base=move_15.Geometry, Direction=Z_3)
inner_cylinder = Geometry(extr_2)
outer_cube = Geometry(extr)

# ---- group: bridge
center_line_3 = Line(center_line)
end_5 = EndPoints(Curve=center_line_3)  # -> Start, End
bottom_point_2 = Point(end_5.Start)
top_point_2 = Point(end_5.End)
X_7 = UnitX(Factor=0.1)
move_16 = Move(Geometry=top_point_2, Motion=X_7)  # -> Geometry, Transform
X_8 = UnitX(Factor=0.01)
move_17 = Move(Geometry=bottom_point_2, Motion=X_8)  # -> Geometry, Transform
eval_5 = EvaluateCurve(Curve=outer_frame, Parameter=top_bridge)  # -> Point, Tangent, Angle
eval_6 = EvaluateCurve(Curve=outer_frame, Parameter=bottom_bridge)  # -> Point, Tangent, Angle
addition_3 = Addition(A=top_bridge, B=1)
eval_7 = EvaluateCurve(Curve=outer_frame, Parameter=addition_3)  # -> Point, Tangent, Angle
addition_4 = Addition(A=bottom_bridge, B=1)
eval_8 = EvaluateCurve(Curve=outer_frame, Parameter=addition_4)  # -> Point, Tangent, Angle
intcrv_3 = Interpolate(Vertices=[eval_8.Point, eval_6.Point, move_17.Geometry, bottom_point_2], Degree=3, Periodic=False, KnotStyle=1)  # -> Curve, Length, Domain
intcrv_4 = Interpolate(Vertices=[eval_5.Point, eval_7.Point, move_16.Geometry, top_point_2], Degree=3, Periodic=False, KnotStyle=1)  # -> Curve, Length, Domain

# ----
ln_4 = Line(StartPoint=eval_8.Point, EndPoint=eval_5.Point)

# ---- group: bridge (continued)
join_2 = JoinCurves(Curves=[center_line_3, intcrv_3.Curve, intcrv_4.Curve, ln_4], Preserve=False)

# ---- group: frame surface
outer_frame_2 = Geometry(outer_frame)
temple = Geometry(join)
brige = Geometry(join_2)
inner_frame = Geometry(move_11.Geometry)
runion = RegionUnion(Curves=flatten([outer_frame_2, brige, temple]))
boundary = BoundarySurfaces(Edges=inner_frame)
boundary_2 = BoundarySurfaces(Edges=runion)
sdiff = SolidDifference(BrepsA=boundary_2, BrepsB=boundary)
frame = Geometry(reverse(sdiff))

# ---- group: frame
frame_surface = Surface(flatten(frame))
bridge_slit_2 = Surface(flatten(bridge_slit))
mirror = Mirror(Geometry=bridge_slit_2, Plane=PlaneYZ(0, 0, 0))  # -> Geometry, Transform
mirror_2 = Mirror(Geometry=frame_surface, Plane=PlaneYZ(0, 0, 0))  # -> Geometry, Transform
Z_4 = UnitZ(Factor=z)
extr_3 = Extrude(Base=[mirror_2.Geometry, frame_surface], Direction=Z_4)
Z_5 = UnitZ(Factor=z)
extr_4 = Extrude(Base=[mirror.Geometry, bridge_slit_2], Direction=Z_5)
sdiff_2 = SolidDifference(BrepsA=extr_3, BrepsB=extr_4)
frame_2 = Geometry(sdiff_2)

# ---- group: frame + hinge
frame_cube = Geometry([frame_2, outer_cube])
sint = SolidIntersection(BrepsA=frame_cube, BrepsB=inner_cylinder)
frame_hinge = Geometry(sint)

# ----
mirror_3 = Mirror(Geometry=frame_hinge, Plane=PlaneYZ(0, 0, 0))  # -> Geometry, Transform
