# Grasshopper definition temple.gh (Grasshopper 0.9.80)

thickness = Slider(2.507, range=1..3)
square = Slider(4.627, range=0..10)
temple = Geometry(<curve referenced from the Rhino model>)
curve = Geometry(<curve referenced from the Rhino model>)

end = EndPoints(Curve=temple)  # -> Start, End
pt = Point(end.Start)
Y = UnitY(Factor=square)
move = Move(Geometry=pt, Motion=Y)  # -> Geometry, Transform
ln = Line(StartPoint=pt, EndPoint=move.Geometry)
swp1 = Sweep1(Rail=temple, Sections=ln, Miter=1)
Z = UnitZ(Factor=Slider(22, range=0..100))
extr = Extrude(Base=swp1, Direction=Z)

# ---- group: hinge
_0_0_0 = Point(<point referenced from the Rhino model>)
Y_2 = UnitY(Factor=square)
move_2 = Move(Geometry=_0_0_0, Motion=Y_2)  # -> Geometry, Transform
ln_2 = Line(StartPoint=move_2.Geometry, EndPoint=_0_0_0)
Z_2 = UnitZ(Factor=square)
extr_2 = Extrude(Base=ln_2, Direction=Z_2)
X = UnitX(Factor=Slider(6.5, range=0..10))
extr_3 = Extrude(Base=extr_2, Direction=X)

# ---- group: curve
Y_3 = UnitY(Factor=Slider(74, range=0..100))
extr_4 = Extrude(Base=curve, Direction=Y_3)
Z_3 = UnitZ(Factor=thickness)
extr_5 = Extrude(Base=extr_4, Direction=Z_3)

# ----
sint = SolidIntersection(BrepsA=extr, BrepsB=extr_5)
right_temple = Geometry([extr_3, sint])
mirror = Mirror(Geometry=right_temple, Plane=PlaneYZ(0, 0, 0))  # -> Geometry, Transform
geo = Geometry([mirror.Geometry, right_temple])
